# Grasshopper definition CaptureTool.gh (Grasshopper 1.0.7)
# plug-ins: Cinnamon

# ----
# 1
capture = Button()
# COPY AND PASTE ME
# TO MAKE CAPTURING EASY
# CAPTURE TOOL
set_me_for_object = Guid()

# ---- group: CAPTURE
nextcapture = NextCapture(ObjectId=set_me_for_object, Reset=capture)
capture_2 = Capture(ObjectId=set_me_for_object, Capture=nextcapture, Save=capture)
savedobjectcaptures = SavedObjectCaptures(ObjectId=set_me_for_object, Reset=capture)

# ----
# PREVIEW CAPTURE
enabled_preview = BooleanToggle(False)
id = Guid(set_me_for_object)
previewcapture = Slider(1, range=0..10)

gate = StreamGate(Stream=previewcapture, Gate=enabled_preview)  # -> Target0, Target1
previewcapture_2 = PreviewCapture(ObjectId=id, Capture=gate.Target1)

interopalted_curve = BooleanToggle(False)
all_captures = Panel(savedobjectcaptures)
skip = Panel("")
difference = SetDifference(SetA=all_captures, SetB=skip)
animatecaptures = AnimateCaptures(ObjectId=set_me_for_object, Captures=difference, Interpolate=interopalted_curve)

# ----
# ANIMATE CAPTURE TOOL
effect = Data(animatecaptures)

# ---- group: OUTPUT
effect_2 = Data(effect)

# ---- group: START / END IN SECONDS
number_slider = Slider(0, range=0..30)
number_slider_2 = Slider(3, range=0..30)

# ----
# 2
effect_3 = Data()

# ----
# PREVIEW EFFECT
number_slider_3 = Slider(0, range=0..1)
player = Player(Movie=effect_3, Seek=number_slider_3, ByFrame=False)

# ----
# 5
movie = Data()

# ----
# PLAY MOVIE
number_slider_4 = Slider(0, range=0..1)
player_2 = Player(Movie=movie, Seek=number_slider_4, ByFrame=False)

# ----
# 3
effects = Data()

# ----
# CREATE MOMENT & SCENE
timerangese = TimeRangeStartEnd(Start=number_slider, End=number_slider_2)
createmoment = CreateMoment(Effects=flatten(effects), Style=3, TimeRange=timerangese)
createscene = CreateScene(Name="New Scene", Moments=createmoment)

scene = Data(createscene)

# ----
# 4
scene_2 = Data()
play_all_at_once = BooleanToggle(False)
gap_seconds = Slider(2, range=0..5)
end_pause_seconds = Slider(2, range=0..5)

# ----
# MERGE SCENES INTO MOVIE
combinescenes = CombineScenes(Scenes=scene_2, CompilationStrategy=play_all_at_once, Gap=gap_seconds)
buildmovie = BuildMovie(Scenes=combinescenes, Fps=Slider(30, range=15..60), EndPause=end_pause_seconds)  # -> Movie, FrameCount

movie_2 = Data(buildmovie.Movie)
