# Grasshopper definition ExampleFile.gh (Grasshopper 1.0.7)
# plug-ins: Cinnamon

# ---- group: Grab clipping plane object and record states
button = Button()
# OBJECT REC &  MOVEMENT
guid = Guid(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)
nextorder = NextOrder(ObjectId=guid, Reset=button)
saveobjectstate = SaveObjectState(ObjectId=guid, Order=nextorder, Save=button)

# ---- group: Click button to add states
# CAMERA REC & MOVEMENT
button_2 = Button()
# RECORD
nextorder_2 = NextOrder(Reset=button_2)
savecamerastate = SaveCameraState(Order=nextorder_2, Save=button_2)

# ----
previeworder = PreviewOrder(ObjectId=guid, Order=Slider(1, range=0..10))

# ---- group: Previewing
previewcamera = PreviewCamera(Order=Slider(3, range=0..10))

# ---- group: First layer settings
# LAYER VISIBILITY
panel = Panel("""Layer 01
Layer 02""")
panel_2 = Panel("""true
false""")
changelayervisibility = ChangeLayerVisibility(Layers=panel, States=panel_2, HideOthers=False)

# ---- group: Second Layer Settings
panel_3 = Panel("""Layer 01
Layer 02""")
# OBJECT MOVEMENT ON CURVE
panel_4 = Panel("""true
false""")
changelayervisibility_2 = ChangeLayerVisibility(Layers=panel_3, States=reverse(panel_4), HideOthers=False)

# ----
guid_2 = Guid(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)
guid_3 = Guid(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)
curve = Curve(<curve referenced from the Rhino model>)
curve_2 = Curve(<curve referenced from the Rhino model>)

# ---- group: Animate clipping plane object
panel_5 = Panel("""1
0""")
animateorders = AnimateOrders(ObjectId=guid, Orders=panel_5, Interpolate=False)

# ---- group: Create animation from cam-rec components
panel_6 = Panel("""1
2""")
# ANIMATE
panel_7 = Panel("""0
1""")
animateorders_2 = AnimateOrders(Orders=panel_7, Interpolate=False)
animateorders_3 = AnimateOrders(Orders=panel_6, Interpolate=False)

# ----
moveobjectoncurve = MoveObjectOnCurve(ObjectId=guid_3, LocationCurve=curve)
moveobjectoncurve_2 = MoveObjectOnCurve(ObjectId=guid_2, LocationCurve=curve_2)

# ---- group: We have 3 shots, and we will break it into 2 moments / scenes. The first goes from shot 0 to 1, then 1 to 2, with a 5 second gap inbetween.
# BUILD MOMENTS
timerange_start_duration = TimeRangeStartDuration(Start=0, Duration=3)
createmoment = CreateMoment(Effects=flatten(animateorders_2), Style=3, TimeRange=timerange_start_duration)
createmoment_2 = CreateMoment(Effects=flatten(animateorders_3), Style=3, TimeRange=timerange_start_duration)

# ----
timerange_start_end = TimeRangeStartEnd(Start="0", End="4")
createmoment_3 = CreateMoment(Effects=flatten(changelayervisibility_2), Style=0, TimeRange=timerange_start_end)
createmoment_4 = CreateMoment(Effects=flatten(changelayervisibility), Style=0, TimeRange=timerange_start_end)

# ---- group: Start the movement of the clipping plane at 3
timerange_start_duration_2 = TimeRangeStartDuration(Start="8", Duration="3")
createmoment_5 = CreateMoment(Effects=flatten(animateorders), Style=3, TimeRange=timerange_start_duration_2)

# ----
timerange_start_duration_3 = TimeRangeStartDuration(Start=0, Duration=3)
createmoment_6 = CreateMoment(Effects=flatten([moveobjectoncurve, moveobjectoncurve_2]), Style=3, TimeRange=timerange_start_duration_3)

# ----
# BUILD SCENES & MOVIES
createscene = CreateScene(Name="New Scene", Moments=createmoment)
createscene_2 = CreateScene(Name="New Scene", Moments=createmoment_2)
combinescenes = CombineScenes(Scenes=[createscene, createscene_2], CompilationStrategy=0, Gap="5")
buildmovie = BuildMovie(Scenes=combinescenes, Fps=30, EndPause=2)  # -> Movie, FrameCount

# ---- group: Create scenes, combine and build movie
createscene_3 = CreateScene(Name="New Scene", Moments=createmoment_4)
createscene_4 = CreateScene(Name="New Scene", Moments=createmoment_3)
# By copying this moment a second time and adding it at the end, I am turning the buildings model back on.
createscene_5 = CreateScene(Name="New Scene", Moments=createmoment_4)
combinescenes_2 = CombineScenes(Scenes=[createscene_3, createscene_4, createscene_5], CompilationStrategy=0, Gap=3)
buildmovie_2 = BuildMovie(Scenes=combinescenes_2, Fps=30, EndPause=2)  # -> Movie, FrameCount

# ----
createscene_6 = CreateScene(Name="New Scene", Moments=createmoment_5)
buildmovie_3 = BuildMovie(Scenes=createscene_6, Fps=30, EndPause=2)  # -> Movie, FrameCount

createscene_7 = CreateScene(Name="New Scene", Moments=createmoment_6)
buildmovie_4 = BuildMovie(Scenes=createscene_7, Fps=30, EndPause=2)  # -> Movie, FrameCount

# ----
# COMBINATION...
combinescenes_3 = CombineScenes(Scenes=[combinescenes, createscene_6, combinescenes_2, createscene_7], CompilationStrategy=1, Gap=3)
buildmovie_5 = BuildMovie(Scenes=combinescenes_3, Fps=30, EndPause=2)  # -> Movie, FrameCount

player = Player(Movie=buildmovie_5.Movie, Seek=Slider(0, range=0..1), ByFrame=False)

# ----
# PLAY
player_2 = Player(Movie=buildmovie.Movie, Seek=Slider(0, range=0..1), ByFrame=False)

player_3 = Player(Movie=buildmovie_2.Movie, Seek=Slider(0, range=0..1), ByFrame=False)

player_4 = Player(Movie=buildmovie_3.Movie, Seek=Slider(0, range=0..1), ByFrame=False)

player_5 = Player(Movie=buildmovie_4.Movie, Seek=Slider(0, range=0..1), ByFrame=False)
